# Grasshopper definition 齿轮-v1-2026.gh (Grasshopper 1.0.8)

# ---- group: 标准齿轮
cluster = Cluster(m=Slider(2, range=0..10), int=Slider(67, range=0..100), bool=Toggle(True), num=Slider(1.36, range=-1..2))  # -> R, geo_2
preview = CustomPreview(Geometry=cluster.geo_2, Material=ColourSwatch(SwatchColor=RGB(97, 145, 145)))

# ==== cluster Cluster
int = ClusterInput()
bool = ClusterInput()
int_2 = Integer(int)

expression = Expression(z=int_2, Expression="0.45 + (z * 0.012) - (z * z * 0.00004)")
expression_2 = Expression(z=int_2, Expression="(17 - z) / 17")
num = ClusterInput()
panel = Panel("变位系数 \(x\) (x-factor)")
num_2 = Number(num)
max = Maximum(A=num_2, B=expression)
min = Minimum(A=max, B=expression_2)
bool_2 = Boolean(bool)
filter = StreamFilter(Gate=bool_2, Stream0=min, Stream1="False")

int_3 = Integer(int_2)
m = ClusterInput()
num_3 = Number(filter)
S = Script(m=m, z=int_3, x=num_3)  # -> out, m, z, A, d, da, df, db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
# ---------- S: Python ----------
import math


m = m #模数 (m)，反映齿轮轮齿大小的几何参数，国家有标准系列值（如 1, 1.5, 2, 2.5, 3, 4 等）。
z = z #齿数 (z)，齿轮轮齿的总数。
A = math.radians(20)  #压力角A,标准齿轮的压力角规定为 20度，（部分特殊设计或英制采用 14.5度 或 25度)。

#标准正常齿规定 (h_a = 1)，(c_c = 0.25)；
#短齿规定(h_a = 0.8)，\(c_c = 0.3)。
h_a = 1 #齿顶高系数h_a;
c_c = 0.25

d = m*z #分度圆直径d;计算和测量的基准圆
ha = (h_a+x)*m #齿顶高ha;标准正常齿：ha = m



hf = (h_a+c_c-x)*m #齿根高hf;标准正常齿：hf =1.25* m
h = ha+hf #全齿高h;标准正常齿：h =2.25* m

da = d+2*ha #齿顶圆直径da;标准正常齿：da = m*(z+2)
df = d-2*hf #齿根圆直径df;标准正常齿：df = m*(z-2.5)
db = d*math.cos(A) #基圆直径db;渐开线起始圆,A=20时,db = 0.9397*d
p = math.pi*m #齿距p;分度圆上相邻两齿同侧轮廓间的弧长

rb = 1/2*db #基圆半径rb

s = 1/2*math.pi*m #齿厚s;标准齿轮在分度圆上齿厚等于槽宽
e = s #槽宽e;标准齿轮在分度圆上齿厚等于槽宽
# ---------- end S ----------
panel_2 = Panel(S.rb)

# ---- group: 渐开线
dom = ConstructDomain(DomainStart=0, DomainEnd="0.8")
range = Range(Domain=dom, Steps="100")
expression_3 = Expression(rb=S.rb, t=range, Expression="rb*(Sin(t)-t*Cos(t))")
expression_4 = Expression(rb=S.rb, t=range, Expression="rb*(Cos(t)+t*Sin(t))")
pt = ConstructPoint(XCoordinate=expression_3, YCoordinate=expression_4, ZCoordinate=0)
intcrv = Interpolate(Vertices=pt, Degree=3, Periodic=False, KnotStyle=1)  # -> Curve, Length, Domain

# ----
merge = Merge(Data1=S.d, Data2=S.da, Data3=S.df, Data4=S.db)
pt_2 = ConstructPoint(XCoordinate=0, YCoordinate=0, ZCoordinate=0)
pln = Plane(pt_2)
expression_5 = Expression(z=S.z, A=S.A, Expression="π/(2*z)+Tan(A)-A")
cir = Circle(Plane=pln, Radius=expr("0.5*x", merge))
sort = SortList(Keys=cir, ValuesA=cir)  # -> Keys, ValuesA
item = ListItem(List=sort.ValuesA, Index=0, Wrap=True)  # -> Item, Item1, Item2, Item3
rotate = Rotate(Geometry=intcrv.Curve, Angle=expression_5, Plane=pln)  # -> Geometry, Transform
end = EndPoints(Curve=rotate.Geometry)  # -> Start, End
pt_3 = Point(end.Start)
ln = Line(StartPoint=pt_3, EndPoint=pln)
merge_2 = Merge(Data1=rotate.Geometry, Data2=ln)
join = JoinCurves(Curves=merge_2, Preserve=False)
mirror = Mirror(Geometry=join, Plane=PlaneYZ(0, 0, 0))  # -> Geometry, Transform
ccx = CurveCurve(CurveA=join, CurveB=item.Item3)  # -> Points, ParamsA, ParamsB
ccx_2 = CurveCurve(CurveA=mirror.Geometry, CurveB=item.Item3)  # -> Points, ParamsA, ParamsB
shatter = Shatter(Curve=join, Parameters=ccx.ParamsA)
shatter_2 = Shatter(Curve=mirror.Geometry, Parameters=ccx_2.ParamsA)
item_2 = ListItem(List=shatter, Index=0, Wrap=True)
item_3 = ListItem(List=shatter_2, Index=0, Wrap=True)
ccx_3 = CurveCurve(CurveA=item_2, CurveB=item.Item3)  # -> Points, ParamsA, ParamsB
ccx_4 = CurveCurve(CurveA=item_3, CurveB=item.Item3)  # -> Points, ParamsA, ParamsB
merge_3 = Merge(Data1=ccx_3.ParamsB, Data2=ccx_4.ParamsB)
shatter_3 = Shatter(Curve=item.Item3, Parameters=merge_3)
item_4 = ListItem(List=shatter_3, Index=0, Wrap=True)
merge_4 = Merge(Data1=item_2, Data2=item_3, Data3=item_4)  # -> flatten(Result)
join_2 = JoinCurves(Curves=merge_4, Preserve=False)
arrpolar = PolarArray(Geometry=join_2, Plane=pln, Count=S.z, Angle=6.283185307)  # -> Geometry, Transform
merge_5 = Merge(Data1=arrpolar.Geometry, Data2=item.Item)  # -> flatten(Result)
runion = RegionUnion(Curves=merge_5, Plane=pln)
Z = UnitZ(Factor=S.s)
extr = Extrude(Base=runion, Direction=Z)
cap = CapHoles(Brep=extr)
geo = Geometry(cap)
R = ClusterOutput(runion)
geo_2 = ClusterOutput(geo)
